# Dynamo custom node CreateExtrusionByLinesDirectionsBottomsTops.dyf (Dynamo 2.5.0.7460)
# category: My General Use
# 閉曲線ごとに配列格納されたLine、押出方向、下部配列、上部配列の入力で効率的に押出を作成

閉曲線配列 = Input(閉曲線配列: var[]..[])
下部高さ配列 = Input(下部高さ配列: var[]..[])
高さ配列 = Input(高さ配列: var[]..[])
押出方向 = Input(押出方向: var[]..[])
py = Python(IN[0]=閉曲線配列, IN[1]=下部高さ配列, IN[2]=高さ配列, IN[3]=押出方向)  # "CreateExtrusionsByLinesBottomsTops.py"
# ---------- py.python (62 lines) ----------
import clr

clr.AddReference('RevitAPI')
from Autodesk.Revit.DB import *
from Autodesk.Revit.DB.Structure import *

clr.AddReference('RevitAPIUI')
from Autodesk.Revit.UI import *

clr.AddReference('System')
from System.Collections.Generic import List

clr.AddReference('RevitNodes')
import Revit
clr.ImportExtensions(Revit.GeometryConversion)
clr.ImportExtensions(Revit.Elements)

clr.AddReference('RevitServices')
import RevitServices
from RevitServices.Persistence import DocumentManager
from RevitServices.Transactions import TransactionManager

doc = DocumentManager.Instance.CurrentDBDocument
uidoc=DocumentManager.Instance.CurrentUIApplication.ActiveUIDocument

#Preparing input from dynamo to revit
lines = UnwrapElement(IN[0])
bottoms = UnwrapElement(IN[1])
tops = UnwrapElement(IN[2])
direction = UnwrapElement(IN[3])

#Translate Dynamo.Geometry.Line to CurveArrArray
a = lambda x:x.ToRevitType()
curveArrArray = CurveArrArray()
for i in lines:#閉曲線の数だけループ
	curveArray = CurveArray()
	closedCurve = map(a,i)
	for j in closedCurve:#閉曲線内の辺の数だけループ
		curveArray.Append(j)
	curveArrArray.Append(curveArray)

#Do some action in a Transaction
solid = []
TransactionManager.Instance.EnsureInTransaction(doc)

vector = XYZ(direction[0],direction[1],direction[2])
for (bottom,top) in zip(bottoms,tops):
	#pl = Plane.CreateByNormalAndOrigin(vector, XYZ(0,0,bottom/304.8))
	#pl = Plane.CreateByNormalAndOrigin(vector, vector*bottom/304.8)
	#押出作成
	pl = Plane.CreateByNormalAndOrigin(vector, XYZ(0,0,0))
	sketchPlane = SketchPlane.Create(doc,pl)
	solid1 = doc.FamilyCreate.NewExtrusion(True, curveArrArray, sketchPlane, top/304.8)
	#押出移動
	transPoint = vector*bottom/304.8
	ElementTransformUtils.MoveElement(doc, solid1.Id, transPoint)
	solid.append(solid1)
	
TransactionManager.Instance.TransactionTaskDone()


OUT = solid
# ----------------------------------------
押出し = Output(py)
code_block = CodeBlock()  # //[[line1,line2,line3],[・・・],[・・・],[・・・]]
code_block_2 = CodeBlock()  # //[0,100,200,300]
code_block_3 = CodeBlock()
# ---------- code_block_3.designscript (2 lines) ----------
//[20,20,20,20]
//bottomsと配列数同じ
# ----------------------------------------
code_block_4 = CodeBlock()  # //[0,0,1][0,1,0][1,0,0]のいずれか
