# Dynamo custom node CreateSweepByCurveProfile.dyf (Dynamo 2.5.0.7460)
# category: My General Use
# スイープを作成

code_block = CodeBlock()  # //[line1,line2,line3]
code_block_2 = CodeBlock()  # //[0,0,1][0,1,0][1,0,0]のいずれか
パス = Input(パス: var[]..[])
プロファイル閉曲線 = Input(プロファイル閉曲線: var[]..[])
パス描画平面の法線 = Input(パス描画平面の法線: var[]..[])
py = Python(IN[0]=パス, IN[1]=プロファイル閉曲線, IN[2]=パス描画平面の法線)  # "CreateSweepByCurveProfile.py"
# ---------- py.python (71 lines) ----------
import clr

clr.AddReference('RevitAPI')
from Autodesk.Revit.DB import *
from Autodesk.Revit.DB.Structure import *

clr.AddReference('RevitAPIUI')
from Autodesk.Revit.UI import *

clr.AddReference('System')
from System.Collections.Generic import List

clr.AddReference('RevitNodes')
import Revit
clr.ImportExtensions(Revit.GeometryConversion)
clr.ImportExtensions(Revit.Elements)

clr.AddReference('RevitServices')
import RevitServices
from RevitServices.Persistence import DocumentManager
from RevitServices.Transactions import TransactionManager

doc = DocumentManager.Instance.CurrentDBDocument
uidoc=DocumentManager.Instance.CurrentUIApplication.ActiveUIDocument

#Preparing input from dynamo to revit
lines = UnwrapElement(IN[0])
profile = UnwrapElement(IN[1])
direction = UnwrapElement(IN[2])

#pathCurveをrefに
a = lambda x:x.ToRevitType()
pathCurveArray = CurveArray()
pathClosedCurve = map(a,lines)
for i in pathClosedCurve:#閉曲線内の辺の数だけループ
	pathCurveArray.Append(i)

#プロファイルのcurveArrArray格納
profCurveArrArray = CurveArrArray()
profCurveArray = CurveArray()
profClosedCurve = map(a,profile[0])
for i in profClosedCurve:#閉曲線内の辺の数だけループ
	profCurveArray.Append(i)
profCurveArrArray.Append(profCurveArray)

#Do some action in a Transaction
solid = []
TransactionManager.Instance.EnsureInTransaction(doc)

#スケッチ平面
pl = Plane.CreateByNormalAndOrigin(XYZ(direction[0],direction[1],direction[2]), XYZ(direction[0]*lines[0].StartPoint.X/304.8,direction[1]*lines[0].StartPoint.Y/304.8,direction[2]*lines[0].StartPoint.Z/304.8))
sketchPlane = SketchPlane.Create(doc,pl)


#プロファイル
sweepProf = doc.Application.Create.NewCurveLoopsProfile(profCurveArrArray)

sweep = doc.FamilyCreate.NewSweep(True, pathCurveArray, sketchPlane,sweepProf, 0, ProfilePlaneLocation.Start)
solid.append(sweep)
"""
for (bottom,top) in zip(bottoms,tops):
	#pl = Plane.CreateByNormalAndOrigin(vector, XYZ(0,0,bottom/304.8))
	pl = Plane.CreateByNormalAndOrigin(vector, vector*bottom/304.8)
	sketchPlane = SketchPlane.Create(doc,pl)
	solid1 = doc.FamilyCreate.NewExtrusion(True, curveArrArray, sketchPlane, top/304.8)
	solid.append(solid1)
	"""
TransactionManager.Instance.TransactionTaskDone()


OUT = solid
# ----------------------------------------
押出し = Output(py)
code_block_3 = CodeBlock()  # //[[line1,line2,line3],[・・・],[・・・],[・・・]]
